# Grasshopper definition Filled Region.ghx (Grasshopper 1.0.7)

mesh = Mesh(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)
topographysurface = CSharpScript(
    m=mesh,
    Update=Toggle(True),
    Reference=["C:\Program Files\Autodesk\Revit 2018\RevitAPI.dll", "C:\Program Files\Autodesk\Revit 2018\RevitAPIUI.dll", "C:\USERS\SUHAIL.YUSUF\SOURCE\REPOS\AECTECH18_RHINOINREVIT\TEST\BIN\DEBUG 2017\RhinoInside.Revit.dll"])  # -> out, A; inputs Update: Boolean
# ---------- topographysurface: C# usings ----------
using Autodesk.Revit.DB;
using Autodesk.Revit.DB.Architecture;
using Autodesk.Revit.UI.Selection;
using Autodesk.Revit.UI;
using RhinoInside.Revit;
using System.Linq;
# ---------- topographysurface: C# ----------
    var tempM = m as Rhino.Geometry.Mesh;
    if (tempM != null)
    {
      x = tempM;
    }

    if(Update)
      Revit.EnqueueAction((uido) => CreateFilledRegion(uido));
# ---------- topographysurface: C# additional code ----------
  Rhino.Geometry.Mesh x;
  public void CreateFilledRegion(Document doc)
  {
    var fs = x.Faces;
    var cs = x.VertexColors;
    var vs = x.Vertices;
    int len = fs.Count;

    //Face Coordinates
    Point3d[] facePointsA = new Point3d[len];
    Point3d[] facePointsB = new Point3d[len];
    Point3d[] facePointsC = new Point3d[len];
    Point3d[] facePointsD = new Point3d[len];

    //Face Colors
    Color[] faceColor = new Color[len];

    int i = 0;
    int j = 0;
    foreach (var f in fs)
    {
      facePointsA[i] = x.Vertices[f.A];
      facePointsB[i] = x.Vertices[f.B];
      facePointsC[i] = x.Vertices[f.C];
      facePointsD[i] = x.Vertices[f.D];
      //faceColor[i] = cs[j];
      i += 1;
      j = j + 4;
    }

    FilteredElementCollector fillRegionTypes = new FilteredElementCollector(doc).OfClass(typeof( FilledRegionType ));
    //List<ElementId> frts = fillRegionTypes.ToElementIds().ToList();
    ElementId frt = fillRegionTypes.FirstElement().Id;
    i = 0;
    List<FilledRegion> filledR = new List<FilledRegion>();
    
    foreach( var f in fs )
    {
      List<CurveLoop> profileloops = new List<CurveLoop>();

      XYZ[] points = new XYZ[5];
      points[0] = new XYZ(facePointsA[i].X, facePointsA[i].Y, facePointsA[i].Z);
      points[1] = new XYZ(facePointsB[i].X, facePointsB[i].Y, facePointsB[i].Z);
      points[2] = new XYZ(facePointsC[i].X, facePointsC[i].Y, facePointsC[i].Z);
      points[3] = new XYZ(facePointsD[i].X, facePointsD[i].Y, facePointsD[i].Z);
      points[4] = new XYZ(facePointsA[i].X, facePointsA[i].Y, facePointsA[i].Z);

      CurveLoop profileloop = new CurveLoop();

      for( int i1 = 0; i1 < 4; i1++ )
      {
        Autodesk.Revit.DB.Line line = Autodesk.Revit.DB.Line.CreateBound(points[i1], points[i1 + 1]);

        profileloop.Append(line);
      }
      profileloops.Add(profileloop);

      ElementId activeViewId = doc.ActiveView.Id;

      FilledRegion filledRegion = FilledRegion.Create(doc, frt, activeViewId, profileloops);
      filledR.Add(filledRegion);
      i = i + 1;
    }
    //return filledR;
  }
# ---------- end topographysurface ----------
