# Grasshopper definition Sample2.ghx (Grasshopper 1.0.7)

geo = Geometry(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)
push_to_bake = Button()
revit_bake = CSharpScript(
    Geometry=geo,
    Bake=push_to_bake,
    Reference=["C:\USERS\MINGO\DOCUMENTS\GITHUB\AECTECH18_RHINOINREVIT\TEST\bin\Debug 2017\RhinoInside.Revit.dll", "C:\Program Files\Autodesk\Revit 2018\RevitAPIUI.dll", "C:\Program Files\Autodesk\Revit 2018\RevitAPI.dll"])  # -> out; inputs Geometry: list of GeometryBase, Bake: Boolean
# ---------- revit_bake: C# usings ----------
using RhinoInside.Revit;
# ---------- revit_bake: C# ----------
    if(Bake)
      Revit.BakeGeometry(Geometry);
# ---------- end revit_bake ----------
panel = Panel(revit_bake)
