# Grasshopper definition Sample3.ghx (Grasshopper 1.0.7)

topographysurface = CSharpScript(
    Update=Toggle(False),
    Reference=["C:\Program Files\Autodesk\Revit 2018\RevitAPI.dll", "C:\Program Files\Autodesk\Revit 2018\RevitAPIUI.dll", "C:\Users\cpatemp\Desktop\rhino.inside\Autodesk\Revit\bin\Debug 2018\RhinoInside.Revit.dll"])  # -> out, A; inputs Update: Boolean
# ---------- topographysurface: C# usings ----------
using Autodesk.Revit.DB;
using Autodesk.Revit.DB.Architecture;
using Autodesk.Revit.UI.Selection;
using Autodesk.Revit.UI;
using RhinoInside.Revit;
# ---------- topographysurface: C# ----------
    if(!Update)
      A = ids;
    else
      Revit.EnqueueAction((uido) => UpdateTopographySurface(uido));
# ---------- topographysurface: C# additional code ----------
  ElementId topographySurfaceId = ElementId.InvalidElementId;
  void UpdateTopographySurface(UIDocument uidoc)
  {
    Selection selection = uidoc.Selection;
    ICollection<ElementId> selectedIds = uidoc.Selection.GetElementIds();

    ids = new List<int>();
    foreach (ElementId id in selectedIds)
    {
      ids.Add(id.IntegerValue);
    }

  }

  List<int> ids = new List<int>();
# ---------- end topographysurface ----------
panel = Panel(topographysurface.A)
