# Grasshopper definition Sample3_convert.ghx (Grasshopper 1.0.7)
# plug-ins: Revit2GH

push_to_bake = Button()
topographysurface = CSharpScript(
    Update=Toggle(False),
    Reference=["C:\Program Files\Autodesk\Revit 2018\RevitAPI.dll", "C:\Program Files\Autodesk\Revit 2018\RevitAPIUI.dll", "C:\USERS\MINGO\DOCUMENTS\GITHUB\AECTECH18_RHINOINREVIT\TEST\bin\Debug 2018\RhinoInside.Revit.dll"])  # -> out, A; inputs Update: Boolean; disabled
# ---------- topographysurface: C# usings ----------
using Autodesk.Revit.DB;
using Autodesk.Revit.DB.Architecture;
using Autodesk.Revit.UI.Selection;
using Autodesk.Revit.UI;
using RhinoInside.Revit;
using System.Linq;
# ---------- topographysurface: C# ----------
    if(!Update)
      A = ghbreps;
    else
    {
      Revit.EnqueueAction((uido) => UpdateTopographySurface(uido));
      A = ghbreps;

      foreach(string s in outVals){
        Print(s);
      }
    }
# ---------- topographysurface: C# additional code ----------
  ElementId topographySurfaceId = ElementId.InvalidElementId;
  //List<List<Point3d>> outputs = new List<List<Point3d>>();
  List<GH_Brep> ghbreps = new List<GH_Brep>();
  List<string> outVals = new List<string>();

  void UpdateTopographySurface(UIDocument uidoc)
  {
    Selection selection = uidoc.Selection;
    ICollection<ElementId> selectedIds = uidoc.Selection.GetElementIds();
    outVals.Add("Num Selection: " + selectedIds.Count.ToString());
    ghbreps = new List<GH_Brep>();
    foreach (ElementId id in selectedIds)
    {
      //var ele = uidoc.Document.GetElement(id).Geometry();
      String faceInfo = "";
      Autodesk.Revit.DB.Options opt = new Options();
      Autodesk.Revit.DB.GeometryElement geomElem = uidoc.Document.GetElement(id).get_Geometry(opt);

      outVals.Add("Num Geo: " + geomElem.Count().ToString());
      foreach (GeometryObject geomObj in geomElem)
      {
        var facePtList = new List<List<Point3d>>();

        Solid geomSolid = geomObj as Solid;
        if (null != geomSolid)
        {

          var brep = new Brep();
          int faces = 0;
          double totalArea = 0;
          outVals.Add("Num Faces: " + geomSolid.Faces.Size.ToString());
          foreach (Face geomFace in geomSolid.Faces)              // get the faces from the solid
          {
            // outVals.Add("Face: " + faces.ToString());
            var facePts = new List<Point3d>();

            outVals.Add("Num Edge Loops: " + geomFace.EdgeLoops.Size.ToString());
            
            var edgeLp = geomFace.EdgeLoops.get_Item(0);
            // foreach (EdgeArray geomEdges in geomFace.EdgeLoops)   // get the edges from each face
            // {

            //outVals.Add("Edge Count: " + edgeLp.Size.ToString());
            int c = 0;
            foreach (Edge edge in edgeLp)                    // get edges from edges
              //foreach (Edge edge in geomEdges)                    // get edges from edges
            {
              c++;
              var crv = edge.AsCurve();
              XYZ p1 = edge.Evaluate(0);                        // extract start point


              var point = new Point3d(p1.X, p1.Y, p1.Z);        // convert to rhino poing
              //   Print(point.ToString());
              facePts.Add(point);                               // save pt to list
              //if (c == geomEdges.Size)
              if (c == edgeLp.Size);
              {
                XYZ p2 = edge.Evaluate(1);                      // get the last point in the edge loop
                var endPt = new Point3d(p2.X, p2.Y, p2.Z);
                facePts.Add(endPt);
              }

            }
            // get wall's geometry edges
            //}

            Rhino.Geometry.Curve tempCurve = Rhino.Geometry.Curve.CreateInterpolatedCurve(facePts, 1);
            if (!tempCurve.IsClosed)                              // close curve, just in case
            {
              //facePts.Add(facePts[0]);
              //tempCurve = Rhino.Geometry.Curve.CreateInterpolatedCurve(facePts, 1);
            }





            List<Brep> breps = new List<Brep>();
            Brep[] planarBreps = Brep.CreatePlanarBreps(tempCurve, 0.01);
            outVals.Add(planarBreps.Count().ToString());
            if (planarBreps != null){
              brep.AddSurface(planarBreps.First());

              var ghB = new GH_Brep(planarBreps.First());

              ObjBreps.Add(ghB);
            }



            //facePtList.Add(facePts);
            //faces++;
            //faceInfo += "Face " + faces + " area: " + geomFace.Area.ToString() + "\n";
            //totalArea += geomFace.Area;
          }

          //faceInfo += "Number of faces: " + faces + "\n";
          //faceInfo += "Total area: " + totalArea.ToString() + "\n";
          break;

        }

        //outputs = facePtList;

      }


      //TaskDialog.Show("Revit", faceInfo);
      //ids.Add(id.IntegerValue);
    }



  }
# ---------- end topographysurface ----------
topographysurface_2 = CSharpScript(
    Update=Toggle(False),
    Reference=["C:\Program Files\Autodesk\Revit 2018\RevitAPI.dll", "C:\Program Files\Autodesk\Revit 2018\RevitAPIUI.dll", "C:\USERS\MINGO\DOCUMENTS\GITHUB\AECTECH18_RHINOINREVIT\TEST\BIN\DEBUG 2018\RhinoInside.Revit.dll"])  # -> out, A; inputs Update: Boolean
# ---------- topographysurface_2: C# ----------
    if(!Update)
      A = ghbreps;
    else
    {
      Revit.EnqueueAction((uido) => UpdateTopographySurface(uido));
      A = ghbreps;

      foreach(string s in outVals){
        Print(s);
      }
    }
# ---------- topographysurface_2: C# additional code ----------
  ElementId topographySurfaceId = ElementId.InvalidElementId;
  //List<List<Point3d>> outputs = new List<List<Point3d>>();
  List<GH_Brep> ghbreps = new List<GH_Brep>();
  List<string> outVals = new List<string>();

  void UpdateTopographySurface(UIDocument uidoc)
  {
    Selection selection = uidoc.Selection;
    ICollection<ElementId> selectedIds = uidoc.Selection.GetElementIds();
    outVals.Add("Num Selection: " + selectedIds.Count.ToString());
    ghbreps = new List<GH_Brep>();
    foreach (ElementId id in selectedIds)
    {
      //var ele = uidoc.Document.GetElement(id).Geometry();
      //String faceInfo = "";
      Autodesk.Revit.DB.Options opt = new Options();
      Autodesk.Revit.DB.GeometryElement geomElem = uidoc.Document.GetElement(id).get_Geometry(opt);

      outVals.Add("Num Geo: " + geomElem.Count().ToString());
      foreach (GeometryObject geomObj in geomElem)
      {

        var facePtList = new List<List<Point3d>>();

        Solid geomSolid = geomObj as Solid;
        if (null != geomSolid)
        {
          //TaskDialog.Show("Revit", "");
          var brepSrfs = new List<Brep>();
          foreach (Face geomFace in geomSolid.Faces)              // get the faces from the solid
          {
            // outVals.Add("Face: " + faces.ToString());
            var facePts = new List<Point3d>();

            outVals.Add("Num Edge Loops: " + geomFace.EdgeLoops.Size.ToString());

            var edgeLp = geomFace.EdgeLoops.get_Item(0);
            // foreach (EdgeArray geomEdges in geomFace.EdgeLoops)   // get the edges from each face
            // {

            //outVals.Add("Edge Count: " + edgeLp.Size.ToString());
            int c = 0;
            foreach (Edge edge in edgeLp)                    // get edges from edges
              //foreach (Edge edge in geomEdges)                    // get edges from edges
            {
              c++;
              var crv = edge.AsCurve();
              XYZ p1 = edge.Evaluate(0);                        // extract start point


              var point = new Point3d(p1.X, p1.Y, p1.Z);        // convert to rhino poing
              //   Print(point.ToString());
              facePts.Add(point);                               // save pt to list
              //if (c == geomEdges.Size)
              if (c == edgeLp.Size);
              {
                XYZ p2 = edge.Evaluate(1);                      // get the last point in the edge loop
                var endPt = new Point3d(p2.X, p2.Y, p2.Z);
                facePts.Add(endPt);
              }

            }
            // get wall's geometry edges
            //}

            Rhino.Geometry.Curve tempCurve = Rhino.Geometry.Curve.CreateInterpolatedCurve(facePts, 1);

            List<Brep> breps = new List<Brep>();
            Brep[] planarBreps = Brep.CreatePlanarBreps(tempCurve, 0.01);
            outVals.Add(planarBreps.Count().ToString());
            if (planarBreps != null){
              brepSrfs.Add(planarBreps[0]);
            }

          }
          var joinedBrep = Rhino.Geometry.Brep.JoinBreps(brepSrfs, 0.01)[0];

          var ghB = new GH_Brep(joinedBrep);
          ghbreps.Add(ghB);

        }


        //outputs = facePtList;

      }


      //TaskDialog.Show("Revit", faceInfo);
      //ids.Add(id.IntegerValue);
    }



  }
# ---------- end topographysurface_2 ----------
revit_bake = CSharpScript(
    Bake=push_to_bake,
    Reference=["C:\USERS\MINGO\DOCUMENTS\GITHUB\AECTECH18_RHINOINREVIT\TEST\bin\Debug 2018\RhinoInside.Revit.dll", "C:\Program Files\Autodesk\Revit 2018\RevitAPIUI.dll", "C:\Program Files\Autodesk\Revit 2018\RevitAPI.dll"])  # -> out; inputs Geometry: list of GeometryBase, Bake: Boolean; disabled
# ---------- revit_bake: C# usings ----------
using RhinoInside.Revit;
# ---------- revit_bake: C# ----------
    if(Bake)
      Revit.BakeGeometry(Geometry);
# ---------- end revit_bake ----------
panel = Panel("https://www.energyplus.net/weather-download/north_and_central_america_wmo_region_4/USA/NY/USA_NY_New.York-LaGuardia.AP.725030_TMY3/all")
ladybug = Ladybug_Ladybug()  # -> Vviiiiiiiiiizzz; plug-in component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
nickname = Revit2GH(_Load=Toggle(False))
brep = Brep(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)
epw_stat = Ladybug_OpenEPWAndSTATWeatherFiles(weatherFileURL=panel)  # -> epwFile, statFile; plug-in component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
panel_2 = Panel(nickname)
panel_3 = Panel("""0,0,0
1,1,2""")
panel_4 = Panel(topographysurface_2.A)
panel_5 = Panel(topographysurface_2.out)
