# Grasshopper definition Sample3_getRevitObj.ghx (Grasshopper 1.0.7)

topographysurface = CSharpScript(
    Update=Toggle(True),
    Reference=["C:\Program Files\Autodesk\Revit 2018\RevitAPI.dll", "C:\Program Files\Autodesk\Revit 2018\RevitAPIUI.dll", "C:\USERS\MINGO\DOCUMENTS\GITHUB\AECTECH18_RHINOINREVIT\TEST\bin\Debug 2017\RhinoInside.Revit.dll"])  # -> out, A; inputs Update: Boolean
# ---------- topographysurface: C# usings ----------
using Autodesk.Revit.DB;
using Autodesk.Revit.DB.Architecture;
using Autodesk.Revit.UI.Selection;
using Autodesk.Revit.UI;
using RhinoInside.Revit;
# ---------- topographysurface: C# ----------
    if(!Update)
      A = ids;
    else
    {
      Revit.EnqueueAction((uido) => UpdateTopographySurface(uido));
      A = ids;
    }
# ---------- topographysurface: C# additional code ----------
  ElementId topographySurfaceId = ElementId.InvalidElementId;
  void UpdateTopographySurface(UIDocument uidoc)
  {
    Selection selection = uidoc.Selection;
    ICollection<ElementId> selectedIds = uidoc.Selection.GetElementIds();

    ids = new List<int>();
    foreach (ElementId id in selectedIds)
    {
      //var ele = uidoc.Document.GetElement(id).Geometry();
      String faceInfo = "";
      Autodesk.Revit.DB.Options opt = new Options();
      Autodesk.Revit.DB.GeometryElement geomElem = uidoc.Document.GetElement(id).get_Geometry(opt);
      foreach (GeometryObject geomObj in geomElem)
      {
        Solid geomSolid = geomObj as Solid;
        if (null != geomSolid)
        {
          int faces = 0;
          double totalArea = 0;
          foreach (Face geomFace in geomSolid.Faces)
          {
            faces++;
            faceInfo += "Face " + faces + " area: " + geomFace.Area.ToString() + "\n";
            totalArea += geomFace.Area;
          }
          faceInfo += "Number of faces: " + faces + "\n";
          faceInfo += "Total area: " + totalArea.ToString() + "\n";
          foreach (Edge geomEdge in geomSolid.Edges)
          {
            // get wall's geometry edges
          }
        }
      }
      TaskDialog.Show("Revit", faceInfo);
      //ids.Add(id.IntegerValue);
    }

  }

  List<int> ids = new List<int>();
# ---------- end topographysurface ----------
panel = Panel(topographysurface.A)
panel_2 = Panel(topographysurface.out)
